% Simulink data dictionary force_interaction.sldd

x_kp = Simulink.Parameter(1, StorageClass="ExportedGlobal")
x_ki = Simulink.Parameter(1, StorageClass="ExportedGlobal")
x_kd = Simulink.Parameter(1, StorageClass="ExportedGlobal")
r_kp = Simulink.Parameter(1, StorageClass="ExportedGlobal")
r_ki = Simulink.Parameter(1, StorageClass="ExportedGlobal")
r_kd = Simulink.Parameter(1, StorageClass="ExportedGlobal")