% Simulink data dictionary free_teaching.sldd

kp = Simulink.Parameter(1, StorageClass="ExportedGlobal")
ki = Simulink.Parameter(1, StorageClass="ExportedGlobal")
kd = Simulink.Parameter(1, StorageClass="ExportedGlobal")
Param = Simulink.Parameter([])
Param1 = Simulink.Parameter([])
Param2 = Simulink.Parameter([])
Param3 = Simulink.Parameter([])
Param4 = Simulink.Parameter([])